vi "FrontPanel.gvi"   [LabVIEW NXG 3.1.0]
panel controls:
  "Pattern Size": f64[2]
  "Display position": f64[]
  "Show display": bool
  "Spot positions": f64[][]
  "Stop": bool
panel indicators:
  "Pattern": f64[][]
uses:
  otslm::initOtslm.mli::initOtslm
  PrismsAndLenses::GenerateImages.gvi
  otslm::tools::combine.gvi
  otslm::tools::finalize.gvi
diagram:
  while {
    call "initOtslm"() -> (error out=w1)
    call "GenerateImages.gvi"(sz=$"Pattern Size", positions=$"Spot positions", error in=w1) -> (Image array=w2, error out=w3)
    call "combine.gvi"(inputs=w2, error in=w3) -> (im=w4, error out=w5)
    call "finalize.gvi"(input=w4, error in=w5) -> (im=w6)
    case ($"Show display") {
      frame False, Default { }
      frame True {
        # TODO: Finish this
      }
    }
    $Pattern <- w6
    stop if $Stop
  }
